% Simulink data dictionary ControlParams.sldd

IEratioSetting = Simulink.Parameter([0.75 0.75 0.5 0.33 0.25 0.25])
deltaDriftClosed = Simulink.Parameter(0.1)  % Proportion of valve travel by which minimum valve position drops each breathing cycle so as to drift minimum pressure down to the PEEP value
deltaFrac = Simulink.Parameter(0.05)  % Proportion of valve travel by which valve demand is modified every time a max or min pressure limit is exceeded
dialVolts = Simulink.Parameter([0.5 1 2 3 4 4.5])
inhaleValveMax = Simulink.Parameter(0.4)  % Maximum inhale valve opening command
modeBPs = Simulink.Parameter([1 2 3 4 5 6])
pressureDynamicRangeSetting = Simulink.Parameter([8 8 11 12 13 13])  % Pressure swing between minimum and maximum values
pressureEng = Simulink.Parameter([0 50])
pressureThresholdMinSetting = Simulink.Parameter([5 5 10 10 10 10])  % Minimum pressure (PEEP value)
pressureVolts = Simulink.Parameter([0.5 4.5])
respRateSetting = Simulink.Parameter([18 18 17 16 15 15])