% Simulink data dictionary Logical_Ventilation_dict.sldd

Dash_Control = Simulink.Bus()
  insp_press: uint8
  RR: uint8
  IERatio: double
  StartStopVent: boolean

Alarm = Simulink.Bus()
  HPress: boolean
  CFail: boolean

Sens = Simulink.Bus()
  flowRate: double
  pProximal: double
  inValveFrac: double
  exValve: double

AirSupply = Simulink.ConnectionBus()
  O2: Connection: foundation.gas.gas
  CO2: Connection: foundation.gas.gas
  Air: Connection: foundation.moist_air.moist_air
  RoomT: Connection: foundation.thermal.thermal

Humidifier = Simulink.Bus()
  Room_H: double, Unit="gram"
  Humidifier_H: double, Unit="gram"
  Insp_Humidity: double, Unit="%"

Thermistor = Simulink.Bus()
  Room_T: double, Unit="degC"
  Water_T: double
  heatedWire_T: double